# Grasshopper definition test.gh (Grasshopper 1.0.7)
# plug-ins: RBF Load

panel = Panel("""5,5,0
5,-5,0
-5,-5,0
-5,5,0""")
pt = Point(panel)
mplane = MeshPlane(Boundary={Plane=PlaneXY(0, 0, 0), Size=Domain2(u=-10..10, v=-10..10)}, WidthCount=10, HeightCount=10)  # -> Mesh, Area
multiplication = Multiplication(A=pt, B=Slider(2, range=0..10))
pt_2 = ConstructPoint(XCoordinate="-6", YCoordinate=0, ZCoordinate=Slider(5, range=0..10))
pt_3 = ConstructPoint(XCoordinate="6", YCoordinate=0, ZCoordinate=Slider(3, range=0..10))
pt_4 = Point([pt_2, pt_3])
rbf_load = RBFLoad(Mesh=mplane.Mesh, Fix=multiplication, Target=pt_4, MaxI=Slider(20, range=0..100), Beta="1e-5")  # -> Mesh, Point, Load, RMSE, I

# ---- group: 荷重ベクトルの情報
vlen = VectorLength(Vector=rbf_load.Load)
avr = Average(Input=vlen)
multiplication_2 = Multiplication(A=rbf_load.Load, B=Slider(50, range=0..100))
panel_2 = Panel(avr)
vdis = VectorDisplay(Anchor=rbf_load.Point, Vector=multiplication_2)

# ----
item = ListItem(List=rbf_load.Point, Index="57", Wrap=True)
item_2 = ListItem(List=rbf_load.Point, Index="63", Wrap=True)
panel_3 = Panel([item, item_2])

# ---- group: RMSE（目標節点との誤差）
panel_4 = Panel(rbf_load.RMSE)
