# Grasshopper definition test.gh (Grasshopper 1.0.7)
# plug-ins: RBF Load, Kangaroo2 Components

panel = Panel("""5,5,0
5,-5,0
-5,-5,0
-5,5,0""")
number_slider = Slider(0.6, range=0..1)
pt = Point(panel)
number_slider_2 = Slider(10, range=0..10)
mplane = MeshPlane(Boundary={Plane=PlaneXY(0, 0, 0), Size=Domain2(u=-10..10, v=-10..10)}, WidthCount=10, HeightCount=10)  # -> Mesh, Area
medges = MeshEdges(Mesh=mplane.Mesh)  # -> NakedEdges, InteriorEdges, NonManifoldEdges
merge = Merge(Data1=medges.NakedEdges, Data2=medges.InteriorEdges)
multiplication = Multiplication(A=pt, B=Slider(2, range=0..10))
pt_2 = ConstructPoint(XCoordinate="-6", YCoordinate=0, ZCoordinate=Slider(5, range=0..10))
pt_3 = ConstructPoint(XCoordinate="6", YCoordinate=0, ZCoordinate=Slider(3, range=0..10))
len = Length(Curve=merge)
demesh = DeconstructMesh(Mesh=mplane.Mesh)  # -> Vertices, Faces, Colours, Normals
pt_4 = Point([pt_2, pt_3])
panel_2 = Panel("0.08")
panel_3 = Panel("0.005")
rbf_load = RBFLoad(Mesh=mplane.Mesh, Fix=multiplication, Target=pt_4, MaxI=Slider(20, range=0..100), Beta="1e-5")  # -> Mesh, Point, Load, RMSE
medges_2 = MeshEdges(Mesh=rbf_load.Mesh)  # -> NakedEdges, InteriorEdges, NonManifoldEdges
merge_2 = Merge(Data1=medges_2.NakedEdges, Data2=medges_2.InteriorEdges)

cp = ClosestPoint(Point=multiplication, Cloud=rbf_load.Point)  # -> ClosestPoint, CPIndex, Distance
toggle = BooleanToggle(True)
length_line = LengthLine(Line=merge_2, Length=len, Strength=10)
anchorxyz = AnchorXYZ(Point=rbf_load.Point, X=toggle, Y=toggle, Z=False, Strength=1000)
anchor = Anchor(Point=cp.ClosestPoint, Strength=10000)
show = Show(G=rbf_load.Mesh)
load = Load(Point=rbf_load.Point, ForceVector=rbf_load.Load, Weighting=1)
merge_3 = Merge(Data1=show, Data2=length_line, Data3=anchor, Data4=anchorxyz, Data5=load)  # -> flatten(Result)
zombiesolver = ZombieSolver(GoalObjects=merge_3, Threshold=1e-10, Tolerance=0.0001, MaxIterations=50000)  # -> I, V, O

toggle_2 = BooleanToggle(True)
anchorxyz_2 = AnchorXYZ(Point=demesh.Vertices, X=toggle_2, Y=toggle_2, Z=False, Strength=1000)
length_line_2 = LengthLine(Line=merge, Length=len, Strength=10)
anchor_2 = Anchor(Point=multiplication, Strength=10000)
load_2 = Load(Point=demesh.Vertices, ForceVector=rbf_load.Load, Weighting=1)
show_2 = Show(G=mplane.Mesh)
merge_4 = Merge(Data1=show_2, Data2=length_line_2, Data3=anchor_2, Data4=anchorxyz_2, Data5=load_2)  # -> flatten(Result)
zombiesolver_2 = ZombieSolver(GoalObjects=merge_4, Threshold=1e-10, Tolerance=0.0001, MaxIterations=50000)  # -> I, V, O

# ---- group: 荷重ベクトルの情報
vlen = VectorLength(Vector=rbf_load.Load)
avr = Average(Input=vlen)
multiplication_2 = Multiplication(A=rbf_load.Load, B=Slider(50, range=0..100))
panel_4 = Panel(avr)
vdis = VectorDisplay(Anchor=rbf_load.Point, Vector=multiplication_2)

# ----
item = ListItem(List=rbf_load.Point, Index="57", Wrap=True)
item_2 = ListItem(List=rbf_load.Point, Index="63", Wrap=True)
panel_5 = Panel([item, item_2])

# ---- group: RMSE（目標節点との誤差）
panel_6 = Panel(rbf_load.RMSE)
