# Grasshopper definition ex1.gh (Grasshopper 1.0.7)
# plug-ins: Karamba3D, Heteroptera, RBF Load

rectangle = Rectangle(Plane=PlaneXY(0, 0, 0), XSize=Domain(0, 20), YSize=Domain(0, 10), Radius=0)  # -> Rectangle, Length
fixed_positions = Panel("""0,0,0
10,0,0
20,0,0
0,10,0
10,10,0
20,10,0""")
target_positions = Panel("""5,5,2
15,5,3""")
mplane = MeshPlane(Boundary=rectangle.Rectangle, WidthCount=Slider(20, range=0..100), HeightCount=10)  # -> Mesh, Area
beta = Panel("1.0e-5")
pt = Point(target_positions)

# ---- group: shape interpolation
pt_2 = Point([fixed_positions, target_positions])
pdecon = Deconstruct(Point=pt_2)  # -> XComponent, YComponent, ZComponent
demesh = DeconstructMesh(Mesh=mplane.Mesh)  # -> Vertices, Faces, Colours, Normals
pt_3 = ConstructPoint(XCoordinate=pdecon.XComponent, YCoordinate=pdecon.YComponent, ZCoordinate=0)
python = GhPythonScript(ref_X=pt_3, ref_Y=pdecon.ZComponent, beta="1e-3")  # -> W; inputs ref_X: list of Point3d, ref_Y: list
# ---------- python: Python ----------
from ghpythonlib.componentbase import executingcomponent as component
import Grasshopper, GhPython
import System
import Rhino
import rhinoscriptsyntax as rs
import os
import math
from clr import AddReferenceToFileAndPath as addref
folderpath = Grasshopper.Folders.UserObjectFolders[0]
addref(os.path.join(folderpath,"MathNet.Numerics.dll"))

import MathNet.Numerics.LinearAlgebra as la
from System import Array as sys_array
def array(*x): return sys_array[float](x) #float is equivalent to .Net double

class MyComponent(component):
    
    def RunScript(self, ref_x, ref_y, beta):
        """Provides a scripting component.
            Inputs:
                x: The x script variable
                y: The y script variable
            Output:
                a: The a output variable"""
        
        __author__ = "Kazuki Hayashi"
        __version__ = "2022.12.30"
        
        import rhinoscriptsyntax as rs
        rbf = lambda x: math.exp(-(beta*x)**2)
        
        n = len(ref_x)
        r_list = [[1.0 for i in range(n)] for j in range(n)]
        for i in range(n-1):
            for j in range(i+1,n):
                r_list[i][j] = rbf(ref_x[i].DistanceTo(ref_x[j]))
                r_list[j][i] = r_list[i][j]
        r = tuple(tuple(r_list[i]) for i in range(n))
        A = la.Double.Matrix.Build.DenseOfRowArrays(r)
        b = la.Double.Vector.Build.DenseOfArray(tuple(ref_y))
        weight = A.Solve(b)
        
        # return outputs if you have them; here I try it for you:
        return weight
# ---------- end python ----------
pdecon_2 = Deconstruct(Point=demesh.Vertices)  # -> XComponent, YComponent, ZComponent
python_2 = GhPythonScript(X=demesh.Vertices, ref_X=pt_3, weight=python, beta="1e-3")  # -> Y; inputs X: list of Point3d, ref_X: list of Point3d, weight: list
# ---------- python_2: Python ----------
from ghpythonlib.componentbase import executingcomponent as component
import Grasshopper, GhPython
import System
import Rhino
import rhinoscriptsyntax as rs
import os
import math
from clr import AddReferenceToFileAndPath as addref
folderpath = Grasshopper.Folders.UserObjectFolders[0]
addref(os.path.join(folderpath,"MathNet.Numerics.dll"))

import MathNet.Numerics.LinearAlgebra as la
from System import Array as sys_array
def array(*x): return sys_array[float](x) #float is equivalent to .Net double

class MyComponent(component):
    
    def RunScript(self, x, ref_x, weight, beta):
        """Provides a scripting component.
            Inputs:
                x: The x script variable
                y: The y script variable
            Output:
                a: The a output variable"""
        
        __author__ = "Kazuki Hayashi"
        __version__ = "2022.12.30"
        
        import rhinoscriptsyntax as rs
        rbf = lambda x: math.exp(-(beta*x)**2)
        
        n = len(ref_x)
        y = [sum([weight[i]*rbf(ref_x[i].DistanceTo(x[j])) for i in range(n)]) for j in range(len(x))]
        
        # return outputs if you have them; here I try it for you:
        return y
# ---------- end python_2 ----------
pt_4 = ConstructPoint(XCoordinate=pdecon_2.XComponent, YCoordinate=pdecon_2.YComponent, ZCoordinate=python_2)
conmesh = ConstructMesh(Vertices=pt_4, Faces=demesh.Faces)
medges = MeshEdges(Mesh=conmesh)  # -> NakedEdges, InteriorEdges, NonManifoldEdges
line = Line([medges.NakedEdges, medges.InteriorEdges])

# ----
Z = UnitZ(Factor=Slider(0, range=0..10))

# ---- group: load interpolation
rbf_load = RBFLoad(Mesh=mplane.Mesh, Fix=fixed_positions, Target=target_positions, I=Slider(10, range=0..10), Beta=beta)  # -> Mesh, Point, Load, RMSE, I

# ----
neg = Negative(Value=Z)
panel = Panel(rbf_load.RMSE)
move = Move(Geometry=demesh.Vertices, Motion=neg)  # -> Geometry, Transform
multiplication = Multiplication(A=rbf_load.Load, B=Slider(25, range=0..100))
medges_2 = MeshEdges(Mesh=rbf_load.Mesh)  # -> NakedEdges, InteriorEdges, NonManifoldEdges
mesh = Mesh(rbf_load.Mesh)
vdisex = VectorDisplayEx(Point=move.Geometry, Vector=multiplication, Colour=RGB(255, 0, 0), Width=2)
mesh_2 = Mesh(rbf_load.Mesh)
number_slider = Slider(1, range=0..10)

number_slider_2 = Slider(14, range=0..20)
matselect = MaterialSelectionKaramba3D(menu=[dropdown(1), dropdown(1)])
panel_2 = Panel(matselect)
medges_3 = MeshEdges(Mesh=mesh_2)  # -> NakedEdges, InteriorEdges, NonManifoldEdges
cross_section = CrossSectionKaramba3D(
    FamilyNameOfCrossSection="DefaultCroSec",
    Material=matselect,
    Diameter_cm=number_slider_2,
    WallThickness_cm=Slider(0.5, range=0..1),
    mode="Circular Hollow")
merge = Merge(Data1=medges_3.NakedEdges, Data2=medges_3.InteriorEdges)
linetobeam = LineToBeamKaramba3D(
    Line=merge,
    CrossSection=cross_section,
    New=True,
    Remove=True,
    LimitDistance_m=0.005,
    Bending=Toggle(True),
    SetBucklingLength=True,
    ToPolylineMaxAngle=0.03,
    ToPolylineTolerance=0.01,
    ToPolylineMaxEdgeLength=0.25)  # -> Element, Points, Info

matselect_2 = MaterialSelectionKaramba3D(menu=[dropdown(7), dropdown(1)])
panel_3 = Panel(matselect_2)
cross_section_2 = CrossSectionKaramba3D(FamilyNameOfCrossSection="DefaultCroSec", Material=matselect_2, Height_cm=Slider(3, range=0..10), mode="Shell - Const")
meshtoshell = MeshToShellKaramba3D(Mesh=mesh_2, CrossSection=cross_section_2, LimitDistance_m=0.005)  # -> Element, Points, Info

X = UnitX(Factor=Slider(1, range=0..10))
Y = UnitY(Factor=Slider(1, range=0..10))
Z_2 = UnitZ(Factor=Slider(1.5, range=0..10))
pt_5 = Point([Point(0, 0, 0), Point(20, 0, 0), Point(0, 10, 0), Point(20, 10, 0), Point(10, 0, 0), Point(10, 10, 0)])
neg_2 = Negative(Value=Z_2)
demesh_2 = DeconstructMesh(Mesh=mesh_2)  # -> Vertices, Faces, Colours, Normals
supp = SupportKaramba3D(PosInd=pt_5, menu=[buttons(on, on, on, off, off, off)])
loads = LoadsKaramba3D(Vector=neg_2, Mesh=mesh_2, LCase="0", mode="MeshLoad -Const.", menu=[buttons(off, on, off), buttons(on, off)])
assemble = AssembleModelKaramba3D(Elem=meshtoshell.Element, Support=supp, Load=loads, LimitDistance_m=0.005)  # -> Model, Info, Mass_kg, CenterOfGravity, LoadCaseNames
analyzenonlin_wip = AnalyzeNonlinearWIPKaramba3D(
    Model=assemble.Model,
    NumberOfLoadSteps=1,
    InitialLoadFactor=0.2,
    MaxNumberOfEquilibriumIterations=50,
    TargetNumberOfEquilibriumIterations=10,
    EquilibriumTolerance=1e-07,
    MaxNumberOfLoadIncrements=30,
    mode="ArcLength")  # -> CalculatedModel, MaximumDisplacement_cm, ElasticEnergy_kNm, Info, Lambdas
analyze = AnalyzeKaramba3D(Model=assemble.Model)  # -> CalculatedModel, MaximumDisplacement_cm, ResultingForceOfGravity_kN, ElasticEnergyChange_kNm
utilization = UtilizationOfElementsKaramba3D(
    AnalyzedModel=analyzenonlin_wip.CalculatedModel,
    NumberOfSamplePoints=3,
    ElasticDesign=True,
    GammaM0=1,
    GammaM1=1.1,
    SwayFrame=True,
    WithDetails=False,
    mode="Beams")  # -> AnalyzedModel, Utilization, SigMax_kN_cm2, SigMin_kN_cm2, TauMax_kN_cm2, UtilN, UtilVy, UtilVz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
panel_4 = Panel(analyze.MaximumDisplacement_cm)
extremums = MinMax(Number=utilization.SigMin_kN_cm2)  # -> Minimum, Maximum
panel_5 = Panel(extremums.Minimum)
extremums_2 = MinMax(Number=utilization.Utilization)  # -> Minimum, Maximum
panel_6 = Panel([extremums_2.Minimum, extremums_2.Maximum])
extremums_3 = MinMax(Number=utilization.SigMax_kN_cm2)  # -> Minimum, Maximum
panel_7 = Panel(extremums_3.Maximum)
nodedisp = NodalDisplacementsKaramba3D(AnalyzedModel=analyzenonlin_wip.CalculatedModel, PositionsIndexes=demesh_2.Vertices)  # -> AnalyzedModel, NodalTranslations_m, NodalRotations_rad
vlen = VectorLength(Vector=nodedisp.NodalTranslations_m)
num = Number(utilization.Utilization)
extremums_4 = MinMax(Number=num)  # -> Minimum, Maximum
extremums_5 = MinMax(Number=vlen)  # -> Minimum, Maximum
shellview = ShellViewKaramba3D(Model=analyze.CalculatedModel, IndexOfLayer=0)  # -> Model, MeshesOfRenderedShells, LegendColors, LegendTags
multiplication_2 = Multiplication(A=number_slider_2, B="0.005")
gradient = Gradient(LowerLimit="0", UpperLimit="1", Parameter=num, stops=[0: RGB(230, 230, 230), 1: RGB(219, 22, 58)])
gradient_2 = Gradient(LowerLimit="0", UpperLimit=extremums_5.Maximum, Parameter=vlen, stops=[0: RGB(230, 230, 230), 1: RGB(0, 204, 136)])

# ---- group: 変形
multiplication_3 = Multiplication(A=nodedisp.NodalTranslations_m, B=Slider(100, range=0..100))
move_2 = Move(Geometry=demesh_2.Vertices, Motion=multiplication_3)  # -> Geometry, Transform
conmesh_2 = ConstructMesh(Vertices=move_2.Geometry, Faces=demesh_2.Faces)
medges_4 = MeshEdges(Mesh=conmesh_2)  # -> NakedEdges, InteriorEdges, NonManifoldEdges

# ----
pipe = Pipe(Curve=merge, Radius=multiplication_2, Caps=0)  # -> flatten(Pipe)
panel_8 = Panel(shellview.LegendTags)
mspray = MeshSpray(Mesh=mesh_2, Points=demesh_2.Vertices, Colours=gradient_2, SprayMode=11)
preview = CustomPreview(Geometry=pipe, Material=gradient)
capture = Capture(Path="C:/Capture", Filename="Capture", Ext=0, CounterOff=False)
