# Grasshopper definition ex2.gh (Grasshopper 1.0.7)
# plug-ins: Kangaroo2 Components, RBF Load, Heteroptera, Pufferfish

crv = Curve(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)
crv_2 = Curve([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])
boundary = BoundarySurfaces(Edges=[crv, crv_2])
mesh = MeshBrep(
    Brep=boundary,
    Settings={GridMaxCount=0, GridMinCount=16, JaggedSeams=False, MaxEdgeLength=0, MinEdgeLength=0.0001, MinTolerance=0, Refine=True, RefineAngle=0, RelativeTolerance=0.65, SimplePlanes=True, Tolerance=0})
triremesh = TriRemesh(Geometry=mesh, Features=[crv, crv_2], Length=Slider(1.5, range=0..10), Iterations=25)  # -> Triangulation, Dual, Creases
brec = BoundingRectangle(Geometry=mesh, Plane=PlaneXY(0, 0, 0), Axis=0, Slide=0, Union=True)  # -> Bounding, DimensionX, DimensionY
cp = ControlPoints(Curve=crv)  # -> Points, Weights, Knots
medges = MeshEdges(Mesh=triremesh.Triangulation)  # -> NakedEdges, InteriorEdges, NonManifoldEdges
demesh = DeconstructMesh(Mesh=triremesh.Triangulation)  # -> Vertices, Faces, Colours, Normals
crv_cp = CurveClosestPoint(Point=cp.Points, Curve=crv)  # -> Point, Parameter, Distance
cp_2 = ClosestPoint(Point=crv_cp.Point, Cloud=demesh.Vertices)  # -> ClosestPoint, CPIndex, Distance
incurves = PointInCurves(Point=demesh.Vertices, Curves=crv_2)  # -> Relationship, Index, Point
python = GhPythonScript(x=incurves.Relationship, p=demesh.Vertices)  # -> a; inputs x: list of Int32, p: list of Point3d
# ---------- python: Python ----------
from ghpythonlib.componentbase import executingcomponent as component
import Grasshopper, GhPython
import System
import Rhino
import rhinoscriptsyntax as rs

class MyComponent(component):
    
    def RunScript(self, x, p):
        """Provides a scripting component.
            Inputs:
                x: The x script variable
                y: The y script variable
            Output:
                a: The a output variable"""
        
        __author__ = "dream"
        __version__ = "2023.07.28"
        
        import rhinoscriptsyntax as rs
        
        p_out = []
        for i in range(len(x)):
            if x[i] == 1:
                p_out.append(p[i])
        # return outputs if you have them; here I try it for you:
        return p_out
# ---------- end python ----------
pt = Point([python, cp_2.ClosestPoint])

# ---- group: pin-support visualization
neg = Negative(Value=Slider(1.5, range=0..10))
Z = UnitZ(Factor=neg)
symadv = SymbolAdvanced(
    Style=7,
    SizePrimary=Slider(10, range=0..100),
    SizeSecondary=10,
    Rotation=0,
    Fill=RGB(0, 0, 0),
    Edge=RGB(0, 0, 0),
    Width=2,
    Adjust=False)
move = Move(Geometry=pt, Motion=Z)  # -> Geometry, Transform
symbol = SymbolDisplay(Location=move.Geometry, Display=symadv)

# ----
capture = Capture(Path="C:/Capture", Filename="Capture", Ext=0)

# ---- group: target points
panel = Panel("""-32,-9,5
-51,-24,5
-60,0,5
-30,20,5
-13,5,5
11,10,5
6,-18,5
27,-25,5
54,-1,5
62,29,5
29,24,5""")
pt_2 = Point(panel)
item = ListItem(List=pt_2, Index=Slider(10, range=0..10), Wrap=True)

# ----
rbf_load = RBFLoad(Mesh=triremesh.Triangulation, Fix=pt, Target=pt_2, I=Slider(10, range=0..100), Beta="1e-1")  # -> Mesh, Point, Load, RMSE, I

# ---- group: target points (continued)
meshcp = MeshClosestPoint(Point=pt_2, Mesh=rbf_load.Mesh)  # -> Point, Index, Parameter
dist = Distance(PointA=pt_2, PointB=meshcp.Point)

# ----
mesh_2 = Mesh(rbf_load.Mesh)

# ---- group: target point visualization
number_slider = Slider(6, range=0..10)
symadv_2 = SymbolAdvanced(
    Style=0,
    SizePrimary=number_slider,
    SizeSecondary=number_slider,
    Rotation=0,
    Fill=RGB(0, 0, 0),
    Edge=RGB(0, 0, 0),
    Width=2,
    Adjust=False)
symbol_2 = SymbolDisplay(Location=pt_2, Display=symadv_2)

# ---- group: load
multiplication = Multiplication(A=rbf_load.Load, B=Slider(15, range=0..100))
vdisex = VectorDisplayEx(Point=demesh.Vertices, Vector=multiplication, Colour=RGB(255, 0, 0), Width=2)
